# Grasshopper definition frame.gh (Grasshopper 0.9.80)

x_y_thickness = Slider(2.514, range=2..3)
width = Slider(136, range=130..140)
z = Slider(5.099, range=3..7)
temple_height = Slider(4.523, range=0..10)
side_thickness = Slider(6.25, range=5.75..6.25)
bottom_temple = Slider(129.908, range=0..200)
top_temple = Slider(-4, range=-50..100)
bridge_thickness = Slider(4.5, range=4.5..5.5)
pd = Slider(66, range=65..70)
bridge_height = Slider(3.143, range=0..7)
nosepiece_height = Slider(3.973, range=1..5)
nosepiece_thickenss = Slider(2.6, range=1..5)
bottom_bridge = Slider(73.217, range=0..100)
temple_xy_angle = Slider(6.4, range=0..10)
top_bridge = Slider(52, range=0..100)
slit_height = Slider(0.2, range=-10..10)
slit_thickness = Slider(0.68, range=0..1)
temple_xz_angle = Slider(6.1, range=0..10)
lens = Geometry(<curve referenced from the Rhino model>)

# ---- group: inner frame
connect = ConnectCurves(Curves=lens, Continuity=2, Close=True, Bulge=1)
closed_lens = Geometry(connect)
area = Area(Geometry=closed_lens)  # -> Area, Centroid
centerpoint = Point(area.Centroid)
pdecon = Deconstruct(Point=centerpoint)  # -> XComponent, YComponent, ZComponent
number = Number(-1)
number_2 = Number(-1)
multiplication = Multiplication(A=pdecon.YComponent, B=number)
multiplication_2 = Multiplication(A=number_2, B=pdecon.XComponent)
X = UnitX(Factor=multiplication_2)
Y = UnitY(Factor=multiplication)
move = Move(Geometry=lens, Motion=X)  # -> Geometry, Transform
move_2 = Move(Geometry=move.Geometry, Motion=Y)  # -> Geometry, Transform
inner_lens = Geometry(move_2.Geometry)

# ---- group: center line
_0_0_0 = Point(Point(0, 0, 0))
Y_2 = UnitY(Factor=bridge_thickness)
move_3 = Move(Geometry=_0_0_0, Motion=Y_2)  # -> Geometry, Transform
bottom_center_bridge = Point(_0_0_0)
top_center_bridge = Point(move_3.Geometry)
Y_3 = UnitY(Factor=bridge_height)
move_4 = Move(Geometry=bottom_center_bridge, Motion=Y_3)  # -> Geometry, Transform
move_5 = Move(Geometry=top_center_bridge, Motion=Y_3)  # -> Geometry, Transform
ln = Line(StartPoint=move_4.Geometry, EndPoint=move_5.Geometry)
center_line = Geometry(ln)

# ---- group: side
division = Division(A=width, B=2)
Y_4 = UnitY(Factor=temple_height)
division_2 = Division(A=width, B=2)
_0 = Number(0)
_0_2 = Number(0)
_0_3 = Number(0)
pt = ConstructPoint(XCoordinate=division, YCoordinate=side_thickness, ZCoordinate=_0)
pt_2 = ConstructPoint(XCoordinate=division_2, YCoordinate=_0_2, ZCoordinate=_0_3)
move_6 = Move(Geometry=pt, Motion=Y_4)  # -> Geometry, Transform
move_7 = Move(Geometry=pt_2, Motion=Y_4)  # -> Geometry, Transform
top_right_point = Point(move_6.Geometry)
bottom_right_point = Point(move_7.Geometry)
ln_2 = Line(StartPoint=move_6.Geometry, EndPoint=move_7.Geometry)
side = Geometry(ln_2)

# ---- group: bridge slit
center_line_2 = Geometry(reverse(center_line))
end = EndPoints(Curve=center_line_2)  # -> Start, End
X_2 = UnitX(Factor=20)
move_8 = Move(Geometry=end.Start, Motion=X_2)  # -> Geometry, Transform
Y_5 = UnitY(Factor=slit_thickness)
move_9 = Move(Geometry=move_8.Geometry, Motion=Y_5)  # -> Geometry, Transform
rec_2pt = Rectangle2Pt(Plane=PlaneXY(0, 0, 0), PointA=move_9.Geometry, PointB=end.Start, Radius=0)  # -> Rectangle, Length
Y_6 = UnitY(Factor=slit_height)
move_10 = Move(Geometry=rec_2pt.Rectangle, Motion=Y_6)  # -> Geometry, Transform
bridge_slit = Surface(move_10.Geometry)

# ---- group: move PD
_2 = Number(2)
division_3 = Division(A=pd, B=_2)
X_3 = UnitX(Factor=division_3)
move_11 = Move(Geometry=inner_lens, Motion=X_3)  # -> Geometry, Transform

# ----
number_slider = Slider(1, range=0..1)

# ---- group: outer frame
offset = Offset(Curve=move_11.Geometry, Distance=x_y_thickness, Plane=PlaneXY(0, 0, 0), Corners=1)
outer_frame = Geometry(flatten(offset))

# ---- group: temple
side_2 = Geometry(side)
end_2 = EndPoints(Curve=side_2)  # -> Start, End
top_point = Point(end_2.Start)
bottom_point = Point(end_2.End)
X_4 = UnitX(Factor=-1)
move_12 = Move(Geometry=top_point, Motion=X_4)  # -> Geometry, Transform
X_5 = UnitX(Factor=-1)
move_13 = Move(Geometry=bottom_point, Motion=X_5)  # -> Geometry, Transform
eval = EvaluateCurve(Curve=outer_frame, Parameter=top_temple)  # -> Point, Tangent, Angle
addition = Addition(A=top_temple, B=1)
eval_2 = EvaluateCurve(Curve=outer_frame, Parameter=addition)  # -> Point, Tangent, Angle
eval_3 = EvaluateCurve(Curve=outer_frame, Parameter=bottom_temple)  # -> Point, Tangent, Angle
addition_2 = Addition(A=bottom_temple, B=1)
eval_4 = EvaluateCurve(Curve=outer_frame, Parameter=addition_2)  # -> Point, Tangent, Angle
intcrv = Interpolate(Vertices=[top_point, move_12.Geometry, eval.Point, eval_2.Point], Degree=3, Periodic=False, KnotStyle=1)  # -> Curve, Length, Domain
ln_3 = Line(StartPoint=eval_2.Point, EndPoint=eval_3.Point)
intcrv_2 = Interpolate(Vertices=[eval_3.Point, eval_4.Point, move_13.Geometry, bottom_point], Degree=3, Periodic=False, KnotStyle=1)  # -> Curve, Length, Domain
join = JoinCurves(Curves=[side_2, ln_3, intcrv.Curve, intcrv_2.Curve], Preserve=False)

# ---- group: hinge
side_temple = Geometry(side)
len = Length(Curve=side_temple)
multiplication_3 = Multiplication(A=len, B=-1)
X_6 = UnitX(Factor=multiplication_3)
move_14 = Move(Geometry=side_temple, Motion=X_6)  # -> Geometry, Transform
end_3 = EndPoints(Curve=move_14.Geometry)  # -> Start, End
end_4 = EndPoints(Curve=side_temple)  # -> Start, End
pt_3 = Point(end_3.Start)
pt_4 = Point(end_4.End)
box = Box2Pt(PointA=pt_3, PointB=pt_4, Plane=PlaneXY(0, 0, 0))
area_2 = Area(Geometry=box)  # -> Area, Centroid
circle = CircleCNR(Center=area_2.Centroid, Normal=Vector(0, 0, 1), Radius=Slider(2.5, range=0..10))
square = Geometry(box)
Z = UnitZ(Factor=1)
move_15 = Move(Geometry=square, Motion=Z)  # -> Geometry, Transform
Z_2 = UnitZ(Factor=1.5)
move_16 = Move(Geometry=circle, Motion=Z_2)  # -> Geometry, Transform
Z_3 = UnitZ(Factor=10)
extr = Extrude(Base=move_15.Geometry, Direction=Z_3)
Z_4 = UnitZ(Factor=20)
extr_2 = Extrude(Base=move_16.Geometry, Direction=Z_4)
inner_cylinder = Geometry(extr_2)
outer_cube = Geometry(extr)
area_3 = Area(Geometry=outer_cube)  # -> Area, Centroid
yz = YZPlane(Origin=area_3.Centroid)
rotate = Rotate(Geometry=outer_cube, Angle=temple_xy_angle, Plane=yz)  # -> Geometry, Transform
area_4 = Area(Geometry=outer_cube)  # -> Area, Centroid
yz_2 = YZPlane(Origin=area_4.Centroid)
rotate_2 = Rotate(Geometry=inner_cylinder, Angle=temple_xy_angle, Plane=yz_2)  # -> Geometry, Transform
inner_cyliner_xy = Geometry(rotate_2.Geometry)
outer_cube_xy = Geometry(rotate.Geometry)
area_5 = Area(Geometry=outer_cube)  # -> Area, Centroid
xz = XZPlane(Origin=area_5.Centroid)
rotate_3 = Rotate(Geometry=outer_cube_xy, Angle=temple_xz_angle, Plane=xz)  # -> Geometry, Transform
area_6 = Area(Geometry=outer_cube)  # -> Area, Centroid
xz_2 = XZPlane(Origin=area_6.Centroid)
rotate_4 = Rotate(Geometry=inner_cyliner_xy, Angle=temple_xz_angle, Plane=xz_2)  # -> Geometry, Transform
cyli = Geometry(rotate_4.Geometry)
outer_cube_2 = Geometry(rotate_3.Geometry)
frame_cube = Geometry(outer_cube_2)
sint = SolidIntersection(BrepsA=frame_cube, BrepsB=cyli)
hinge = Geometry(sint)

# ---- group: bridge
center_line_3 = Line(center_line)
end_5 = EndPoints(Curve=center_line_3)  # -> Start, End
bottom_point_2 = Point(end_5.Start)
top_point_2 = Point(end_5.End)
X_7 = UnitX(Factor=0.1)
move_17 = Move(Geometry=top_point_2, Motion=X_7)  # -> Geometry, Transform
X_8 = UnitX(Factor=0.01)
move_18 = Move(Geometry=bottom_point_2, Motion=X_8)  # -> Geometry, Transform
eval_5 = EvaluateCurve(Curve=outer_frame, Parameter=top_bridge)  # -> Point, Tangent, Angle
eval_6 = EvaluateCurve(Curve=outer_frame, Parameter=bottom_bridge)  # -> Point, Tangent, Angle
addition_3 = Addition(A=top_bridge, B=1)
eval_7 = EvaluateCurve(Curve=outer_frame, Parameter=addition_3)  # -> Point, Tangent, Angle
addition_4 = Addition(A=bottom_bridge, B=1)
eval_8 = EvaluateCurve(Curve=outer_frame, Parameter=addition_4)  # -> Point, Tangent, Angle
intcrv_3 = Interpolate(Vertices=[eval_8.Point, eval_6.Point, move_18.Geometry, bottom_point_2], Degree=3, Periodic=False, KnotStyle=1)  # -> Curve, Length, Domain
intcrv_4 = Interpolate(Vertices=[eval_5.Point, eval_7.Point, move_17.Geometry, top_point_2], Degree=3, Periodic=False, KnotStyle=1)  # -> Curve, Length, Domain

# ----
ln_4 = Line(StartPoint=eval_8.Point, EndPoint=eval_5.Point)

# ---- group: bridge (continued)
join_2 = JoinCurves(Curves=[center_line_3, intcrv_3.Curve, intcrv_4.Curve, ln_4], Preserve=False)

# ---- group: frame surface
outer_frame_2 = Geometry(outer_frame)
temple = Geometry(join)
brige = Geometry(join_2)
inner_frame = Geometry(move_11.Geometry)
runion = RegionUnion(Curves=flatten([outer_frame_2, brige, temple]))
boundary = BoundarySurfaces(Edges=inner_frame)
boundary_2 = BoundarySurfaces(Edges=runion)
sdiff = SolidDifference(BrepsA=boundary_2, BrepsB=boundary)
frame = Geometry(reverse(sdiff))

# ---- group: nosepiece
frame_2 = Geometry(runion)
explode = Explode(Curve=frame_2, Recursive=True)  # -> Segments, Vertices
pt_5 = Point(<point referenced from the Rhino model>)
crv_cp = CurveClosestPoint(Point=pt_5, Curve=explode.Segments)  # -> Point, Parameter, Distance
sort = SortList(Keys=crv_cp.Distance, ValuesA=explode.Segments)  # -> Keys, ValuesA
item = ListItem(List=sort.ValuesA, Index=0, Wrap=True)
crv = Curve(item)
curvepoint = PointOnCurve(crv, parameter=0.895)
curvepoint_2 = PointOnCurve(crv, parameter=0.544)
curvepoint_3 = PointOnCurve(crv, parameter=0.092)
Z_5 = UnitZ(Factor=nosepiece_height)
move_19 = Move(Geometry=curvepoint_2, Motion=Z_5)  # -> Geometry, Transform
intcrv_5 = Interpolate(Vertices=[curvepoint, move_19.Geometry, curvepoint_3], Degree=3, Periodic=False, KnotStyle=1)  # -> Curve, Length, Domain
Z_6 = UnitZ(Factor=-10)
extr_3 = Extrude(Base=intcrv_5.Curve, Direction=Z_6)
X_9 = UnitX(Factor=nosepiece_thickenss)
extr_4 = Extrude(Base=extr_3, Direction=X_9)
fat_ass_cube = Geometry(<brep referenced from the Rhino model>)
sdiff_2 = SolidDifference(BrepsA=extr_4, BrepsB=fat_ass_cube)
Z_7 = UnitZ(Factor=z)
move_20 = Move(Geometry=sdiff_2, Motion=Z_7)  # -> Geometry, Transform

# ---- group: frame
frame_surface = Surface(flatten(frame))
bridge_slit_2 = Surface(flatten(bridge_slit))
Z_8 = UnitZ(Factor=z)
extr_5 = Extrude(Base=frame_surface, Direction=Z_8)
Z_9 = UnitZ(Factor=15)
extr_6 = Extrude(Base=bridge_slit_2, Direction=Z_9)
frame_3 = Geometry(extr_5)
slit = Geometry(extr_6)
sdiff_3 = SolidDifference(BrepsA=frame_3, BrepsB=slit)
frame_with_slit = Geometry(sdiff_3)

# ----
right_nosepiece = Geometry(move_20.Geometry)
right_hinge = Geometry(hinge)
right_frame = Geometry(frame_with_slit)
sunion = SolidUnion(Breps=[right_frame, right_hinge, right_nosepiece])
mirror = Mirror(Geometry=sunion, Plane=PlaneYZ(0, 0, 0))  # -> Geometry, Transform
left_frame = Geometry(mirror.Geometry)
sunion_2 = SolidUnion(Breps=[left_frame, sunion])
full_frame = Geometry(sunion_2)
