# Grasshopper definition temple.gh (Grasshopper 0.9.80)

thickness = Slider(1.27, range=1..10)
square = Slider(4.6, range=4.5..5)
temple = Geometry(<curve referenced from the Rhino model>)

# ---- group: temple
scale_nu = ScaleNU(Geometry=temple, Plane=PlaneXY(0, 0, 0), ScaleX=Slider(0.93, range=0..1), ScaleY=1, ScaleZ=1)  # -> Geometry, Transform
end = EndPoints(Curve=scale_nu.Geometry)  # -> Start, End
pt = Point(end.Start)
Y = UnitY(Factor=square)
move = Move(Geometry=pt, Motion=Y)  # -> Geometry, Transform
ln = Line(StartPoint=pt, EndPoint=move.Geometry)
swp1 = Sweep1(Rail=scale_nu.Geometry, Sections=ln, Miter=1)
Z = UnitZ(Factor=thickness)
extr = Extrude(Base=swp1, Direction=Z)

# ---- group: hinge
end_2 = EndPoints(Curve=temple)  # -> Start, End
pt_2 = Point(end_2.Start)
Y_2 = UnitY(Factor=square)
move_2 = Move(Geometry=pt_2, Motion=Y_2)  # -> Geometry, Transform
ln_2 = Line(StartPoint=pt_2, EndPoint=move_2.Geometry)
Z_2 = UnitZ(Factor=square)
extr_2 = Extrude(Base=ln_2, Direction=Z_2)
X = UnitX(Factor=6.5)
extr_3 = Extrude(Base=extr_2, Direction=X)

# ----
sunion = SolidUnion(Breps=[extr_3, extr])
mirror = Mirror(Geometry=sunion, Plane=PlaneYZ(0, 0, 0))  # -> Geometry, Transform
bake_me = Geometry([mirror.Geometry, sunion])
